# Grasshopper definition mobius.gh (Grasshopper 0.9.76)
# plug-ins: Biomorpher, MeshEdit Components, LunchBox, Weaverbird

number_slider = Slider(3, range=0..5)
number_slider_2 = Slider(6, range=2..10)
number_slider_3 = Slider(55, range=29..100)
mobius = MobiusSurface(
    UDivisions=100,
    VDivisions=100,
    RParameter=4,
    TParameter=number_slider,
    Scale=5,
    Domain1=Domain(-3.141592654, 3.141592654),
    Domain2=Domain(-1, 1))
hex = HexagonCells(Surface=mobius, UDivisions=number_slider_3, VDivisions=number_slider_2, TParameter=0.25)  # -> HexagonCells, Centers
wbframe = WeaverbirdsPictureFrame(MeshPolylines=hex.HexagonCells, Distance=5, InsetType=0)
wbthicken = WeaverbirdsMeshThicken(MeshCurves=wbframe, Distance=Slider(2.9, range=0..10), OffsetType=0)
area = MeshArea(Mesh=wbthicken)  # -> Area, Centroid
mcol = MeshColours(
    Mesh=wbthicken,
    Colours=[RGB(127, 255, 0), RGB(0, 100, 0), RGB(34, 139, 34), RGB(124, 252, 0), RGB(154, 205, 50), RGB(173, 255, 47), RGB(50, 205, 50), RGB(152, 251, 152)])
biomorpher = Biomorpher(Sliders=[number_slider, number_slider_2, number_slider_3], Geometry=mcol, Performas=area.Area)
list_item = ListItem(List=biomorpher, Index=0, Wrap=True)  # -> Item, Item1, Item2
construct_point = ConstructPoint(XCoordinate=list_item.Item, YCoordinate=list_item.Item1, ZCoordinate=list_item.Item2)

# ---- group: Cluster no.
cluster = Slider(0, range=0..12)

# ----
shift_paths = ShiftPaths(Data=construct_point, Offset=-1)
panel = Panel(biomorpher)
tree_branch = TreeBranch(Tree=shift_paths, Path=cluster, MaintainPaths=True)
